# Grasshopper definition Vonoroi_01.ghx (Grasshopper 1.0.8)

xy = XYPlane(Origin=Point(0, 0, 0))
cir = Circle(Plane=xy, Radius=Slider(8, range=0..10))
crv = Curve(cir)
box = Box(cir)
divide = DivideCurve(Curve=crv, Count=Slider(17, range=3..20), Kinks=False)  # -> Points, Tangents, Parameters
debrep = DeconstructBrep(Brep=box)  # -> Faces, Edges, Vertices
ln = Line(StartPoint=divide.Points, EndPoint=graft(divide.Points))
item = ListItem(List=debrep.Faces, Index=0, Wrap=True)
divide_2 = DivideCurve(Curve=ln, Count=Slider(4, range=0..10), Kinks=False)  # -> Points, Tangents, Parameters
midpt = CurveMiddle(Curve=ln)
boundary = BoundarySurfaces(Edges=cir)
cullpt = CullDuplicates(Points=flatten(divide_2.Points), Tolerance=0.1, CullMode=3)  # -> Points, Indices, Valence
voronoi = Voronoi(Points=flatten([midpt, cullpt.Points]), Plane=xy, BruteForceOverride=False)
bcx = BrepCurve(Brep=boundary, Curve=voronoi)  # -> Curves, Points
neg = Negative(Value=Slider(0.126, range=0..1))
boundary_2 = BoundarySurfaces(Edges=bcx.Curves)
offset = OffsetCurve(Curve=boundary_2, Distance=neg, Corners=1)
fillet = Fillet(Curve=offset, Radius=Slider(0.342, range=0..1))
Z = UnitZ(Factor=Slider(0.3, range=0..1))
Z_2 = UnitZ(Factor=Slider(0.422, range=0..1))
boundary_3 = BoundarySurfaces(Edges=flatten([boundary_2, fillet]))
extr = Extrude(Base=boundary_2, Direction=Z)
extr_2 = Extrude(Base=boundary_3, Direction=Z_2)
