# Grasshopper definition Vonoroi_Phyllotaxis.ghx (Grasshopper 1.0.8)

number_slider = Slider(61, range=0..100)
X = UnitX(Factor=1)
pt = ConstructPoint(XCoordinate=0, YCoordinate=0, ZCoordinate=0)
spoke = Slider(15, range=0..20)
line = LineSDL(Start=pt, Direction=X, Length=number_slider)
xy = XYPlane(Origin=Point(0, 0, 0))
arrpolar = PolarArray(Geometry=line, Plane=xy, Count=spoke, Angle=degrees(Slider(360, range=0..360)))  # -> Geometry, Transform
maelstrom = Maelstrom(
    Geometry=arrpolar.Geometry,
    Plane=xy,
    First=Slider(2.676, range=0.1..20),
    Second=Slider(100, range=20..100),
    Angle=degrees(Slider(59, range=50..120)),
    Rigid=False)
divide = DivideCurve(Curve=maelstrom, Count=Slider(5, range=0..100), Kinks=False)  # -> flatten(Points), Tangents, Parameters
cull_i = CullIndex(List=divide.Points, Indices="0", Wrap=True)
cir = Circle(Plane=PlaneXY(0, 0, 0), Radius=number_slider)
voronoi = Voronoi(Points=cull_i, BruteForceOverride=False)
rint = RegionIntersection(CurvesA=voronoi, CurvesB=cir)
subtraction = Subtraction(A=Slider(8.902, range=0..10), B=10)
offset = OffsetCurve(Curve=rint, Distance=subtraction, Corners=1)
offset_2 = OffsetCurve(Curve=offset, Distance=Slider(0.45, range=0..2), Corners=1)
fillet = FilletDistance(Curve=offset, Distance=Slider(0.959, range=0..10))
fillet_2 = FilletDistance(Curve=offset_2, Distance=Slider(1.1, range=0..2))
boundary = BoundarySurfaces(Edges=flatten([fillet_2, rint]))
boundary_2 = BoundarySurfaces(Edges=flatten([fillet, rint]))
Z = UnitZ(Factor=Slider(5, range=0..10))
Z_2 = UnitZ(Factor=Slider(5.5, range=0..10))
extr = Extrude(Base=boundary, Direction=Z_2)
extr_2 = Extrude(Base=boundary_2, Direction=Z)
preview = CustomPreview(
    Geometry=[extr_2, extr],
    Material={diffuse=RGB(221, 160, 221), emission=RGB(66, 48, 66), shine=0.5, specular=RGB(255, 255, 255), transparency=0})

range = Range(Domain=Slider(16, range=15..300), Steps=Slider(20, range=0..100))
range_2 = Range(Domain=Slider(66, range=15..75), Steps=Slider(20, range=0..100))
xz = XZPlane(Origin=Point(0, 0, 0))
pt_2 = ConstructPoint(XCoordinate=range, YCoordinate=0, ZCoordinate=0)
rad = Radians(Degrees=range_2)
cir_2 = Circle(Plane=xz, Radius=Slider(2.5, range=0..100))
rotate = Rotate(Geometry=pt_2, Angle=rad, Plane=xz)  # -> Geometry, Transform
cir_3 = Circle(Plane=xz, Radius=Slider(16, range=0..100))
cull_i_2 = CullIndex(List=rotate.Geometry, Indices="0", Wrap=True)
xz_2 = XZPlane(Origin=Point(0, 0, 0))
boundary_3 = BoundarySurfaces(Edges=[cir_2, cir_3])
intcrv = Interpolate(Vertices=cull_i_2, Degree=3, Periodic=False, KnotStyle=1)  # -> Curve, Length, Domain
arrpolar_2 = PolarArray(Geometry=intcrv.Curve, Plane=xz_2, Count=Slider(24, range=0..100), Angle=6.283185307)  # -> Geometry, Transform
mirror = Mirror(Geometry=arrpolar_2.Geometry, Plane=PlaneYZ(0, 0, 0))  # -> Geometry, Transform
srfsplit = SurfaceSplit(Surface=boundary_3, Curves=[mirror.Geometry, arrpolar_2.Geometry])
debrep = DeconstructBrep(Brep=srfsplit)  # -> Faces, Edges, Vertices
join = JoinCurves(Curves=debrep.Edges, Preserve=False)
area = Area(Geometry=join)  # -> Area, Centroid
larger = LargerThan(FirstNumber=area.Area, SecondNumber=Slider(0.5, range=-1..0.5))  # -> LargerThan, OrEqualTo
cull = CullPattern(List=join, CullPattern=larger.OrEqualTo)
offset_3 = OffsetCurve(Curve=cull, Distance=Slider(-0.289, range=-1..0), Corners=1)
fillet_3 = Fillet(Curve=offset_3, Radius=Slider(0.081, range=0..1))
boundary_4 = BoundarySurfaces(Edges=flatten([join, fillet_3]))
